# Grasshopper definition Piramid_Script.gh (Grasshopper 1.0.8)
# plug-ins: Pufferfish

number_slider = Slider(260, range=0..1000)
rectangle = Rectangle(Plane=PlaneXY(0, 0, 0), XSize=number_slider, YSize=number_slider, Radius=0)  # -> Rectangle, Length
unit_z = UnitZ(Factor=Slider(152, range=0..1000))
move = Move(Geometry=rectangle.Rectangle, Motion=unit_z)  # -> Geometry, Transform
area = Area(Geometry=move.Geometry)  # -> Area, Centroid
scale = Scale(Geometry=move.Geometry, Center=area.Centroid, Factor=Slider(0.17, range=0.05..10))  # -> Geometry, Transform
loft = Loft(
    Curves=[scale.Geometry, rectangle.Rectangle],
    Options={Adjust=False, Closed=False, LoftEnds=0, LoftSimp=0, LoftType=0, Rebuild=10, Refit=0.01})
cap_holes = CapHoles(Brep=loft)
unroll_polysurface = UnrollPolysurface(Polysurface=cap_holes, Explode=Slider(0, range=0..1))  # -> Unrolled, UnrolledPoints, UnrolledCurves
